# Dynamo graph loading_Rotterdam.dyn "test_load_1" (Dynamo 2.12.1.8246)

# group: Create BoundingBox for load OSM data
min_point = CodeBlock { 51.91020828569069; 4.487396343632447; 0; }
max_point = CodeBlock { 51.918991298866686; 4.513016030364533; 0; }
OSM_data = osm2dyn.OSM_data.OSM_data(min_longitude=min_point.out1, min_latitude=min_point.out0, max_longitude=max_point.out1, max_latitude=max_point.out0)

OSM_polylines = osm2dyn.OSM_data.OSM_polylines(oSM_data=OSM_data)  # frozen

# group: Getting polygons andreproject data from geographic coordinates and project to UTM84-31N
code_block = CodeBlock { 4326; 32631; }
OSM_polygons = osm2dyn.OSM_data.OSM_polygons(oSM_data=OSM_data)
getGeometry = osm2dyn.OSM_object.GetGeometry(oSM_object=OSM_polygons)
reproject_point_as_double_array = dyn_proj_library.Reprojecting.Reproject_point_as_double_array(cs_source_code=code_block.out0, cs_target_code=code_block.out1, source_point=getGeometry)
getAttributes = osm2dyn.OSM_object.GetAttributes(oSM_object=OSM_polygons)

# group: Create Buildings from polygons
byPoints = Polygon.ByPoints(points=reproject_point_as_double_array)
heightOfStorey = DoubleInput(3)
getBuildingsPolygons = Python(IN[0]=byPoints, IN[1]=getAttributes, IN[2]=heightOfStorey)  # IronPython2
# ---------- getBuildingsPolygons.python (22 lines) ----------
#input_data
polygons = IN[0]
attributes = IN[1]
storey_height = float(IN[2])

import clr
clr.AddReference('ProtoGeometry')
from Autodesk.DesignScript.Geometry import Curve, Line, Point, Polygon

counter_1 = 0
osm_buildins = list()
osm_natural = list()
for one_dict in attributes:
	#check, is that plg is building
	plg_needing = polygons[counter_1]
	plg_center = plg_needing.Center()
	if one_dict.get("building") != None:
		level_value_temp = one_dict.get("height",storey_height)
		level_value = float(level_value_temp)
		osm_buildins.append(Curve.SweepAsSolid(plg_needing,Line.ByStartPointEndPoint(plg_center, Point.ByCoordinates(plg_center.X,plg_center.Y,plg_center.Z + level_value))))
	counter_1+=1
OUT = osm_buildins
# ----------------------------------------

OSM_points = osm2dyn.OSM_data.OSM_points(oSM_data=OSM_data)  # frozen

# group: Reproject point (f.e. with some offsetting as in Revit-base point)
offset_in_meters = CodeBlock { 603100.0; 5752800.0; 0.0; 0.0; 1.0; }
reprojecting = dyn_proj_library.Reprojecting.Reprojecting(dx=offset_in_meters.out0, dy=offset_in_meters.out1, dz=offset_in_meters.out2, angle_value=offset_in_meters.out3, scale=offset_in_meters.out4)  # unwired: source_point
dynamoPoint = dyn_proj_library.Reprojecting.DynamoPoint(reprojecting=reprojecting)
